# Grasshopper definition packing.gh (Grasshopper 1.0.7)
# plug-ins: Kangaroo2 Components

minlength = Slider(20, range=20..70)
maxlength = Slider(70, range=20..70)
minwidth = Slider(20, range=20..70)
maxwidth = Slider(70, range=20..70)
minangle = Slider(0, range=0..180)
maxangle = Slider(138, range=0..180)
minheight = Slider(20, range=20..50)
maxheight = Slider(103, range=20..200)
count = Slider(10, range=1..10)
pt = ConstructPoint(XCoordinate=0, YCoordinate=0, ZCoordinate=0)
pt_2 = ConstructPoint(XCoordinate=Slider(28, range=0..100), YCoordinate=Slider(100, range=0..100), ZCoordinate=0)
pt_3 = ConstructPoint(XCoordinate=Slider(69, range=0..100), YCoordinate=Slider(100, range=0..100), ZCoordinate=0)
pt_4 = ConstructPoint(XCoordinate=Slider(100, range=0..100), YCoordinate=Slider(28, range=0..100), ZCoordinate=0)
pt_5 = ConstructPoint(XCoordinate=Slider(47, range=0..100), YCoordinate=Slider(0, range=0..100), ZCoordinate=0)
minlength_2 = GetNumber(minlength, AtLeast=1, AtMost=1, Maximum=50, Minimum=20)
maxlength_2 = GetNumber(maxlength, AtLeast=1, AtMost=1, Maximum=50, Minimum=20)
minwidth_2 = GetNumber(minwidth, AtLeast=1, AtMost=1, Maximum=1.797693135e+308, Minimum=-1.797693135e+308)
maxwidth_2 = GetNumber(maxwidth, AtLeast=1, AtMost=1, Maximum=1.797693135e+308, Minimum=-1.797693135e+308)
minangle_2 = GetNumber(minangle, AtLeast=1, AtMost=1, Maximum=1.797693135e+308, Minimum=-1.797693135e+308)
maxangle_2 = GetNumber(maxangle, AtLeast=1, AtMost=1, Maximum=1.797693135e+308, Minimum=-1.797693135e+308)
minheight_2 = GetNumber(minheight, AtLeast=1, AtMost=1, Maximum=1.797693135e+308, Minimum=-1.797693135e+308)
maxheight_2 = GetNumber(maxheight, AtLeast=1, AtMost=1, Maximum=1.797693135e+308, Minimum=-1.797693135e+308)
count_2 = GetNumber(count, AtLeast=1, AtMost=1, Maximum=1.797693135e+308, Minimum=-1.797693135e+308)
merge = Merge(Data1=pt, Data2=pt_2, Data3=pt_3, Data4=pt_4, Data5=pt_5)
dom = ConstructDomain(DomainStart=minlength_2, DomainEnd=maxlength_2)
dom_2 = ConstructDomain(DomainStart=minwidth_2, DomainEnd=maxwidth_2)
dom_3 = ConstructDomain(DomainStart=minangle_2, DomainEnd=maxangle_2)
dom_4 = ConstructDomain(DomainStart=minheight_2, DomainEnd=maxheight_2)
siteverticies = GetPoint(merge, AtLeast=3, AtMost=1, Realtime=True)
pline = PolyLine(Vertices=siteverticies, Closed=Toggle(True))
random = Random(Range=dom, Number=count_2, Seed=2)
random_2 = Random(Range=dom_2, Number=count_2, Seed=2)
random_3 = Random(Range=dom_3, Number=count_2, Seed=2)
random_4 = Random(Range=dom_4, Number=count_2, Seed=2)
patch = Patch(Curves=pline, Spans=20, Flexibility=1, Trim=True)
popgeo = PopulateGeometry(Geometry=patch, Count=count_2, Seed=1)
rectangle = Rectangle(Plane=popgeo, XSize=random, YSize=random_2, Radius=0)  # -> Rectangle, Length
area = Area(Geometry=rectangle.Rectangle)  # -> Area, Centroid
rotate = Rotate(Geometry=rectangle.Rectangle, Angle=degrees(random_3), Plane=area.Centroid)  # -> Geometry, Transform
area_2 = Area(Geometry=rotate.Geometry)  # -> Area, Centroid
area_3 = Area(Geometry=patch)  # -> Area, Centroid
ma = MassAddition(Input=area_2.Area)  # -> Result, PartialResults
sqrt = SquareRoot(Value=area_3.Area)
sqrt_2 = SquareRoot(Value=ma.Result)
division = Division(A=sqrt, B=sqrt_2)
scale = Scale(Geometry=rotate.Geometry, Center=popgeo, Factor=division)  # -> Geometry, Transform
crv = Curve(scale.Geometry)
disc = Discontinuity(Curve=scale.Geometry, Level=1)  # -> Points, Parameters
xy = XYPlane(Origin=Point(0, 0, 0))
cpc = CurvePointCollide(
    Points=disc.Points,
    Curve=pline,
    Plane=PlaneXY(0, 0, 0),
    Interior=invert(False),
    Strength=Slider(0.0001, range=0.0001..10))
rigidpointset = RigidPointSet(Points=disc.Points, Strength=10)  # -> RigidBody, Planes
show = Show(G=crv)
cc = CurveCollide(Curves=scale.Geometry, BasePlane=xy, Strength=1)  # -> Goal, Frames
merge_2 = Merge(Data1=show, Data2=cpc, Data3=rigidpointset.RigidBody, Data4=cc.Goal)
zombiesolver = ZombieSolver(GoalObjects=merge_2, Threshold=1e-10, Tolerance=0.0001, MaxIterations=50000)  # -> I, V, O
clean = CleanTree(RemoveNulls=True, RemoveInvalid=True, RemoveEmpty=False, Tree=zombiesolver.O)  # -> graft(Tree)
c_script = CSharpScript(x=clean)  # -> out, flatten(A); inputs x: list
# ---------- c_script: C# ----------
    A = x[0];
# ---------- end c_script ----------
str = String(c_script.A)
c_script_2 = CSharpScript(x=str, y="Polyline Curve")  # -> A; inputs x: String, y: String
# ---------- c_script_2: C# ----------
    if(x == y) A = true;
    else A = false;
# ---------- end c_script_2 ----------
dispatch = Dispatch(List=c_script.A, DispatchPattern=c_script_2)  # -> ListA, ListB
split = SplitList(List=dispatch.ListA, Index=count_2)  # -> ListA, ListB
Z = UnitZ(Factor=random_4)
bnd = Bounds(Numbers=random_4)
remap = RemapNumbers(Value=random_4, Source=bnd, Target=Domain(0, 1))  # -> Mapped, Clipped
extr = Extrude(Base=split.ListA, Direction=Z)
runion = RegionUnion(Curves=split.ListA)
cap = CapHoles(Brep=extr)
mesh = MeshBrep(
    Brep=cap,
    Settings={GridMaxCount=0, GridMinCount=16, JaggedSeams=False, MaxEdgeLength=0, MinEdgeLength=0.0001, MinTolerance=0, Refine=True, RefineAngle=0, RelativeTolerance=0.65, SimplePlanes=True, Tolerance=0})
area_4 = Area(Geometry=runion)  # -> Area, Centroid
len = Length(Curve=runion)
gradient = Gradient(
    LowerLimit=0,
    UpperLimit=1,
    Parameter=remap.Mapped,
    stops=[0: RGB(0, 0, 139), 0.328: RGB(72, 61, 139), 0.703: RGB(123, 104, 238), 1: RGB(192, 192, 255), 1: RGB(230, 230, 250)])
volume = Volume(Geometry=cap)  # -> Volume, Centroid
ma_2 = MassAddition(Input=area_4.Area)  # -> Result, PartialResults
ma_3 = MassAddition(Input=len)  # -> Result, PartialResults
ma_4 = MassAddition(Input=volume.Volume)  # -> Result, PartialResults
demesh = DeconstructMesh(Mesh=mesh)  # -> Vertices, Faces, Colours, Normals
total_area = Panel(ma_2.Result)
total_perimeter = Panel(ma_3.Result)
total_volume = Panel(ma_4.Result)
panel = Panel("""residential
commercial
office
recreational
healthcare
educational
daycare
restaurant
hotel
industrial""")
conmesh = ConstructMesh(Vertices=demesh.Vertices, Faces=demesh.Faces, Colours=graft(gradient))  # -> flatten(Mesh)
concat = Concatenate(FragmentA="total area: ", FragmentB=total_area, FragmentC=" m2")
concat_2 = Concatenate(FragmentA="total volume: ", FragmentB=total_volume, FragmentC=" m3")
concat_3 = Concatenate(FragmentA="total perimeter: ", FragmentB=total_perimeter, FragmentC=" m")
c_script_3 = CSharpScript(mesh=conmesh, color=gradient, area=concat, perimeter=concat_3, volume=concat_2)  # -> out, A; inputs mesh: Mesh, color: Color, area: String, perimeter: String, volume: String
# ---------- c_script_3: C# ----------
    var c = color.R + "," + color.G + "," + color.B;
    mesh.SetUserString("color", c);
    mesh.SetUserString("area", area);
    mesh.SetUserString("perimeter", perimeter);
    mesh.SetUserString("volume", volume);
    A = mesh;
# ---------- end c_script_3 ----------
explode = Explode(Curve=pline, Recursive=True)  # -> flatten(Segments), Vertices
c_script_4 = CSharpScript(crv=explode.Segments, color=ColourSwatch(SwatchColor=RGB(255, 0, 0)))  # -> out, A; inputs crv: Curve, color: Color
# ---------- c_script_4: C# ----------
    var c = color.R + "," + color.G + "," + color.B;
    crv.SetUserString("color", c);
    A = crv;
# ---------- end c_script_4 ----------

# ---- group: RH_OUT:mesh
mesh_2 = Mesh(c_script_3.A)

# ---- group: RH_OUT:line
crv_2 = Curve(c_script_4.A)
